# Dynamo graph script.dyn (Dynamo 2.10.1.3976)
# packages: Crumple 2024.4.3, Genius Loci 2024.2.26, Data-Shapes 2024.2.114

# group: Search for all "STRUCTURAL FOUNDATIONS" with the type name equalling [REFER TO ORANGE GROUP BELOW]
element_by_id = ElementById()  # unwired: Id
categories = Categories("OST_StructuralFoundation")
all_elements_of_category = ElementsOfCategory(Category=categories)

# group: Order Piles by X and Y co-ordinates (by survey point) - NOTUSED
getLocation = Element.GetLocation(element=element_by_id)
convert_from_internalorigin = Custom[Convert from InternalOrigin CoordinateSystem](point=getLocation)  # package Genius Loci; Get the location point in the 3 coordinate systems : Shared Coordinates, Project Coordinates, Relative Origin Coordinates.
Y = Point.Y(point=convert_from_internalorigin.Point_Survey_System)
number = DoubleInput(3)
round = Math.Round(number=Y, digits=number)
sortByKey = List.SortByKey(list=element_by_id, keys=round)
groupByKey = List.GroupByKey(list=sortByKey.sortedList, keys=sortByKey.sortedKeys)
reverse = List.Reverse(list=groupByKey.groups)
getLocation_2 = Element.GetLocation(element=reverse)
convert_from_internalorigin_2 = Custom[Convert from InternalOrigin CoordinateSystem](point=getLocation_2)
X = Point.X(point=convert_from_internalorigin_2.Point_Survey_System)
number_2 = DoubleInput(3)
round_2 = Math.Round(number=X, digits=number_2)
sortByKey_2 = List.SortByKey(list=reverse, keys=round_2, lacing=Shortest)

# group: Search for Parameter
code_block = CodeBlock { "Pile Category"; }

getParameterValueByName = Element.GetParameterValueByName(element=all_elements_of_category, parameterName=code_block)

# group: First Selection - Drop Down
code_block_2 = CodeBlock { "Select Pile Group to rename [MUST USE DROP DOWN LIST]"; }
string = StringInput("Pile Category")
getParameterValueByName_2 = Element.GetParameterValueByName(element=all_elements_of_category, parameterName=string)
uniqueItems = List.UniqueItems(list=getParameterValueByName_2)
list_sortnatural = Custom[List SortNatural](list=uniqueItems)  # package Genius Loci; Sorts a specified list in natural order in either ascending or descending order.
watch = Watch(list_sortnatural)
ui_dropdownform = Custom[🐍 UI.DropdownForm](formTitle=code_block_2, keys=watch, values=watch)  # package Crumple; Creates a basic dropdown form from a set of keys and values. If cancelled, the form will return nothing (null).

# group (continued): Search for all "STRUCTURAL FOUNDATIONS" with the type name equalling [REFER TO ORANGE GROUP BELOW]
contains = String.Contains(str=getParameterValueByName, searchFor=ui_dropdownform.chosenValue)
filterByBoolMask = List.FilterByBoolMask(list=all_elements_of_category, mask=contains)
familytype_name = Custom[© FamilyType.Name](familyTypes=filterByBoolMask.in)  # package Crumple; For a family type or list of family types, returns the type names.
id = Element.Id(element=filterByBoolMask.in)

watch_2 = Watch(filterByBoolMask.in)
watch_3 = Watch(contains)
element_by_id_2 = ElementById(Id=id)

# group: Order Piles by X and Y co-ordinates (by basepoint)
getLocation_3 = Element.GetLocation(element=element_by_id_2)
Y_2 = Point.Y(point=getLocation_3)
number_3 = DoubleInput(3)
round_3 = Math.Round(number=Y_2, digits=number_3)
sortByKey_3 = List.SortByKey(list=element_by_id_2, keys=round_3)
groupByKey_2 = List.GroupByKey(list=sortByKey_3.sortedList, keys=sortByKey_3.sortedKeys)
reverse_2 = List.Reverse(list=groupByKey_2.groups)
getLocation_4 = Element.GetLocation(element=reverse_2)
X_2 = Point.X(point=getLocation_4)
number_4 = DoubleInput(3)
round_4 = Math.Round(number=X_2, digits=number_4)
sortByKey_4 = List.SortByKey(list=reverse_2, keys=round_4, lacing=Shortest)

# group: Validate drop down was used + error message
contains_2 = List.Contains(list=watch, item=ui_dropdownform.chosenValue)
code_block_3 = CodeBlock { "Piles - Group "; }
add = code_block_3 + ui_dropdownform.chosenValue
code_block_4 = CodeBlock { "ERROR! DROP DOWN LIST WAS NOT USED, CANCEL AND TRY AGAIN."; }
if_ = If(test=contains_2, true=add, false=code_block_4)
watch_4 = Watch(contains_2)

file_path = Filename(".\Pile Numbering Guidance Doc.docx")
code_block_5 = CodeBlock { "Cancel"; }

# group: User Interface + extract user input
code_block_6 = CodeBlock { "Confirm"; }
code_block_7 = CodeBlock { "Pile Prefix"; "P"; }
textbox_data = Custom[TextBox Data](InputName=code_block_7.out0, DefaultText=code_block_7.out1)  # package Data-Shapes; Create Data for TextBox input in UI.MultipleInputForm ++ . Check out www.data-shapes.net for more informations
code_block_8 = CodeBlock { "Pile No. Padding"; "3"; }
textbox_data_2 = Custom[TextBox Data](InputName=code_block_8.out0, DefaultText=code_block_8.out1)
list_create = List.Create(item0=textbox_data, item1=textbox_data_2)
boolean = BoolSelector(true)
multipleinputform = Custom[MultipleInputForm ++](Description_optional=if_, ButtonText_optional=code_block_6, Inputs=list_create, Toggle=boolean, LinkToHelp_optional=file_path, CancelButtonText_optional=code_block_5)  # package Data-Shapes; Create a form with multiple inputs. see www.data-shapes.net for tutorials and infos!
watch_5 = Watch(multipleinputform.User_Inputs)
code_block_9 = CodeBlock { 1; }
code_block_10 = CodeBlock { 2; }
slice = List.Slice(list=watch_5, start=code_block_9, end=code_block_10)
watch_6 = Watch(slice)
code_block_11 = CodeBlock(X=watch_6) { X[0]; }
watch_7 = Watch(code_block_11)
toNumber = String.ToNumber(str=watch_7)
code_block_12 = CodeBlock { 0; }
code_block_13 = CodeBlock { 1; }
slice_2 = List.Slice(list=watch_5, start=code_block_12, end=code_block_13)
watch_8 = Watch(slice_2)
code_block_14 = CodeBlock(X=watch_8) { X[0]; }
watch_9 = Watch(code_block_14)
length = String.Length(str=watch_9)
add_2 = length + toNumber

# group: Add Prefix and padding (P00X)
flatten = List.Flatten(list=sortByKey_4.sortedList)
string_2 = StringInput("Mark")
count = List.Count(list=flatten)
code_block_15 = CodeBlock(c=count) { (1..c)+""; }
code_block_16 = CodeBlock { "0"; }
padLeft = String.PadLeft(str=code_block_15, newWidth=toNumber, padChars=code_block_16)
padLeft_2 = String.PadLeft(str=padLeft, newWidth=add_2, padChars=watch_9)
setParameterByName = Element.SetParameterByName(element=flatten, parameterName=string_2, value=padLeft_2)

code_block_17 = CodeBlock {  }
